# Grasshopper definition CurveCompressor.gh (Grasshopper 1.0.7)

range = Range(Domain=Domain(0, 1), Steps=1000)
surface = Surface(<surface referenced from the Rhino model>)
curve = Curve(<curve referenced from the Rhino model>)
evaluate_curve = EvaluateCurve(Curve=reparameterize(curve), Parameter=range)  # -> Point, Tangent, Angle
surface_closest_point = SurfaceClosestPoint(Point=evaluate_curve.Point, Surface=surface)  # -> Point, UVPoint, Distance
evaluate_surface = EvaluateSurface(Surface=surface, Point=surface_closest_point.UVPoint)  # -> Point, Normal, UDirection, VDirection, Frame
script_1_tbd = GhPythonScript(x=evaluate_curve.Point, y=evaluate_curve.Tangent, z=evaluate_surface.Normal)  # -> out, shiftedPoints
# ---------- script_1_tbd: Python ----------
"""Provides a scripting component.
    Inputs:
        x: Points along Curve
        y: Vectors tangent to curve at each point
        z: Vectors normal to surface at each point
    Output:
        a: The a output variable"""

__author__ = "Shoon"
__version__ = "2020.11.04"

import rhinoscriptsyntax as rs

epsilon = 0.01


# Compute the cross product of the above two vectors at each point
crosses = rs.VectorCrossProduct(y,z)

# Displace points along said cross product by some distance
shiftedPoints = rs.VectorAdd(x,epsilon*crosses)

# Copy points up by epsilon and down by epsilon to form a ribbon


# Take the intersection of the ribbon with the surface and draw it
# ---------- end script_1_tbd ----------
surface_closest_point_2 = SurfaceClosestPoint(Point=script_1_tbd.shiftedPoints, Surface=surface)  # -> Point, UVPoint, Distance
evaluate_surface_2 = EvaluateSurface(Surface=surface, Point=surface_closest_point_2.UVPoint)  # -> Point, Normal, UDirection, VDirection, Frame
ghpython_script = GhPythonScript(x=script_1_tbd.shiftedPoints, y=evaluate_surface_2.Point)  # -> out, a
# ---------- ghpython_script: Python ----------
"""
Interpolate points in y on surface
"""


__author__ = "Shoon"
__version__ = "2020.11.04"

import rhinoscriptsyntax as rs
# ---------- end ghpython_script ----------
