# Grasshopper definition S20.gh (Grasshopper 1.0.7)
# plug-ins: treesloth01

wide = Slider(0.341, range=-10..10)
taper = Slider(0.047, range=-0.2..0.2)
genus_2_surface = Genus2Surface(
    wide=wide,
    long=Slider(2.895, range=0..5),
    round=Slider(4.141, range=0..10),
    thick=Slider(8.693, range=0..10),
    taper=taper)  # -> L, P, geo_2
num = Number(0.1)
construct_domain = ConstructDomain(DomainStart=0, DomainEnd=1)
curve = Curve(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)
integer = Integer(8)
s20_and_master_curve_cluster = S20AndMasterCurveCluster(P=genus_2_surface.P, geo=genus_2_surface.geo_2, epsilon=num)  # -> pt_2, geo_3, reparameterize(full_curve), original_curves, offset_curves, punct_curves
python = GhPythonScript()  # -> out, example
# ---------- python: Python ----------
__author__ = "will"
__version__ = "2021.04.03"

import rhinoscriptsyntax as rs

example = [((3,0),(1,0)),((~1,0),(~2,0)),((2,0),(1,1)),((~1,1),(~2,0)),((2,0),(~0,0)),((0,0),(~3,0))]
# ---------- end python ----------
# Here's a complicated, inefficient curve that can be used as input as we work on code to "flow" a curve to a geodesic (efficient representative).
crv = Curve(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)
num_2 = Number(500)
range = Range(Domain=construct_domain, Steps=integer)
panel = Panel(python.example)
cluster = Cluster(curve=crv, brep=genus_2_surface.geo_2, steps=num_2)
panel_2 = Panel(s20_and_master_curve_cluster.original_curves)
flip = FlipCurve(Curve=flatten(s20_and_master_curve_cluster.original_curves))  # -> reparameterize(Curve), Flag
flip_2 = FlipCurve(Curve=flatten(s20_and_master_curve_cluster.punct_curves))  # -> reparameterize(Curve), Flag
flip_3 = FlipCurve(Curve=flatten(s20_and_master_curve_cluster.offset_curves))  # -> reparameterize(Curve), Flag
flip_4 = FlipCurve(Curve=flatten(s20_and_master_curve_cluster.full_curve))  # -> reparameterize(Curve), Flag
evaluate_curve = EvaluateCurve(Curve=reparameterize(curve), Parameter=range)  # -> Point, Tangent, Angle
crv_2 = Curve(cluster)
crv_3 = Curve(flip.Curve)
crv_4 = Curve(flip_3.Curve)
crv_5 = Curve(reparameterize(flip_2.Curve))
eval = EvaluateCurve(Curve=flip_3.Curve, Parameter=Slider(0.433, range=0..1))  # -> Point, Tangent, Angle
python_2 = GhPythonScript(
    Run=Toggle(True),
    file="FlipperToGH_v3.py",
    initial_curve="b",
    mapping_class="aBeFcdAE",
    iterations=Slider(2, range=0..5),
    x=Button())  # -> out, data
# ---------- python_2: Python ----------
__author__ = "will"
__version__ = "2021.03.16"

import rhinoscriptsyntax as rs
import subprocess
triangulation = [(~1,~8,~0),(~7,3,8),(~2,~6,7),(~5,2,6),(~3,~4,5),(0,1,4)]

import os

if ghdoc.Path:
    direc = os.path.dirname(ghdoc.Path)

    
Path = os.path.join(direc, file)


iterations = str(int(iterations))

args = [str(initial_curve), str(mapping_class), iterations]

if Run:
    
    getpy = subprocess.Popen(["which", "python3"],stdout=subprocess.PIPE)
    dir = getpy.communicate()
    #print(dir)
    
    comm = subprocess.Popen(['/usr/bin/python', Path] + args, stdout=subprocess.PIPE)
    stdout = comm.communicate()
    
    stdout=stdout[0]
    
    
    if stdout[:9] == 'Traceback':
        print stdout
    else:
        data=eval(stdout)
    

    comm.stdout.close()
    comm.wait()
# ---------- end python_2 ----------
python_3 = GhPythonScript(Run=Toggle(True), file="FlipperToGH.py", curve="[1,0,1,0,1,1,0,1,1]")  # -> out, data
# ---------- python_3: Python ----------
__author__ = "will"
__version__ = "2021.03.16"

import rhinoscriptsyntax as rs
import subprocess
import os
triangulation = [(~1,~8,~0),(~7,3,8),(~2,~6,7),(~5,2,6),(~3,~4,5),(0,1,4)]

curve = curve.replace(',','').replace('[','').replace(']','')

if ghdoc.Path:
    direc = os.path.dirname(ghdoc.Path)

    
Path = os.path.join(direc, file)


args = [curve]
if Run:
    
    comm = subprocess.Popen(['python3', Path] + args, stdout=subprocess.PIPE)
    stdout = comm.communicate()
    
    stdout=stdout[0]
    
    if stdout[:9] == 'Traceback':
        print stdout
    else:
        data=eval(stdout)
    

    comm.stdout.close()
    comm.wait()
# ---------- end python_3 ----------
stack = StackTrees(Data0=crv_3, Data1=crv_4, Reduce=True)  # -> flatten(Tree)
sort_map_curves = GhPythonScript(mapCurves=flip.Curve, offsetMapCurves=flip_3.Curve)  # -> out, mapCurveDict; unedited script template
panel_3 = Panel(python_2.out)
panel_4 = Panel(python_2.data)
panel_5 = Panel(python_3.data)
panel_6 = Panel(python_3.out)
abstract_points_to_rhino3dpoints = GhPythonScript(mapCurveList=stack, abstractPointsList=python_2.data)  # -> out, pairedPushPoints3D, GH_pairedPushPoints3D; inputs mapCurveList: list, abstractPointsList: list
# ---------- abstract_points_to_rhino3dpoints: Python ----------
"""Provides a scripting component.
    Inputs:
        mapCurveList: An ordered list of rhino curves
        abstractPointsList: A list of numbered intersections with each map edge, 
            as processed by flipper
    Output:
        pairedPushPoints3D: A list of pairs of 3d points corresponding to the 
            intersection points indicated in the abstractPointsList"""

__author__ = "Shoon"
__version__ = "2021.03.26"

import rhinoscriptsyntax as rs

# Count the number of intersection points on each edge.
# This will tell us how we should space them out.
pointsPerEdge = {}

for pair in abstractPointsList:
    for intersection in pair:
        if (intersection[0] not in pointsPerEdge.keys()):
            pointsPerEdge[intersection[0]] = 1
        else:
            pointsPerEdge[intersection[0]] += 1

# Place the points on each curve, limited to the parameter range [0.1, 0.9].
# Staying away from where we meet the puncture curves is a little safer.
pairedPushPoints3D = []
GH_pairedPushPoints3D = []

for pair in abstractPointsList:
    firstParam = (0.8 * (pair[0][1]/pointsPerEdge[pair[0][0]])) + 0.1
    first = rs.EvaluateCurve(mapCurveList[pair[0][0]], firstParam)
    secondParam = (0.8 * (pair[1][1]/pointsPerEdge[pair[1][0]])) + 0.1
    second = rs.EvaluateCurve(mapCurveList[pair[1][0]], secondParam)
    pairedPushPoints3D.append((first, second))
    GH_pairedPushPoints3D.append(first)
    GH_pairedPushPoints3D.append(second)
    
pairedPushPoints3D = pairedPushPoints3D
print(pairedPushPoints3D)
# ---------- end abstract_points_to_rhino3dpoints ----------
eval_2 = EvaluateCurve()  # -> Point, Tangent, Angle
eval_3 = EvaluateCurve(Curve=s20_and_master_curve_cluster.full_curve, Parameter=graft(0))  # -> Point, Tangent, Angle
eval_4 = EvaluateCurve(Curve=crv_5, Parameter=graft([0, 1]))  # -> Point, Tangent, Angle
pt = Point(abstract_points_to_rhino3dpoints.GH_pairedPushPoints3D)
panel_7 = Panel(abstract_points_to_rhino3dpoints.out)
panel_8 = Panel(abstract_points_to_rhino3dpoints.pairedPushPoints3D)
sph = Sphere(Base=eval_3.Point, Radius=Slider(0.138, range=0..1))
sph_2 = Sphere(Base=eval_4.Point, Radius=Slider(0.102, range=0..1))
sort_points_by_push_order = GhPythonScript(curve=s20_and_master_curve_cluster.full_curve, pairedPointsList=abstract_points_to_rhino3dpoints.pairedPushPoints3D)  # -> out, sortedPointPairs
# ---------- sort_points_by_push_order: Python ----------
"""Provides a scripting component.
    Inputs:
        pairedPointsList: Collection of pairs of Rhino points
        curve: Master curve to put points on (for grabbing params)
            Must be parametrized on [0,1]
    Output:
        a: The list of pairs of 3dRhinoPoints sorted in the order they should be
            applied to the master curve."""

__author__ = "Shoon"
__version__ = "2021.02.26"

import rhinoscriptsyntax as rs
"The order of pairing:"
"List all possible ways of connection and categorize them by degree."
"Those with lower order are always connected first."
"For multiple curves that have the same degree, we deal with those that connect"
"the same two edges first."
"Based on the connection's orientation (0 or 1), we find an order that also depends on the points' coordinates."
"The pairs of connection are always written in the (smaller, larger) order."
"The key is the pair and the value is the connection's type."
deg1 = {(6,7):0, (6,8):1, (~6,7):0, (~6,1):1, (~8,1):0, (~8,~1):1, (~7,~1):0, (~7,8):1}
deg2 = {(7,8):1, (1,7):1, (~8,~6):0, (~8,~7):1, (~1,8):1, (~7,6):1}
deg3 = {(~6,8):0, (1,6):1, (~8,7):0, (~6,~1):1, (~7,1):0, (~1,6):1}
deg4 = {(1,8):0, (~8,6):1, (~1,7):1, (~7,~6):0}

#Need to convert this to Grasshopper edges instead of Flipper edges.

def reorder_a_pair(pair):
    if pair[1] < pair[0]:
        return (pair[1], pair[0])
    else:
        return pair

def getpair(connection):
    #A connection is in this form: ((edge1, index1),(edge2, index2))
    #Get the pair fo connection and also reorder it.
    return reorder_a_pair((connection[0][0], connection[1][0]))
    
def compare_index(connection1, connection2):
    #Return the one with the smaller index.
    if connection1[0][0] < connection1[1][0]:
        if connection2[0][0] < connection2[1][0]:
            if connection1[0][1] < connection2[0][1]:
                return connection1
            elif connection1[0][1] > connection2[0][1]:
                return connection2
        elif connection2[0][0] > connection2[1][0]:
            if connection1[0][1] < connection2[1][1]:
                return connection1
            elif connection1[0][1] > connection2[1][1]:
                return connection2
    elif connection1[0][0] > connection1[1][0]:
        if connection2[0][0] < connection2[1][0]:
            if connection1[1][1] < connection2[0][1]:
                return connection1
            elif connection1[1][1] > connection2[0][1]:
                return connection2
        elif connection2[0][0] > connection2[1][0]:
            if connection1[1][1] < connection2[1][1]:
                return connection1
            elif connection1[1][1] > connection2[1][1]:
                return connection2

def reorder_same_type(this_type, type):
    #This function reorders a list of connections of the same type, i. e. connecting the same pair of edges.
    print(type)
    if (type in deg1) == True:
        orientation = deg1[type]
    elif (type in deg2) == True:
        orientation = deg2[type]
    elif (type in deg3) == True:
        orientation = deg3[type]
    elif (type in deg4) == True:
        orientation = deg4[type]
    this_type_new = [this_type[0]]
    for connection in this_type[1:]:
        for i in range(0, len(this_type_new)):
            if orientation == 0:
                if compare_index(connection, this_type_new[i]) == connection:
                    this_type_new.insert(i, connection)
                    break
                elif compare_index(connection, this_type_new[i]) == this_type_new[i]:
                    if i == len(this_type_new)-1:
                        this_type_new.append(connection)
            elif orientation == 1:
                if compare_index(connection, this_type_new[i]) == this_type_new[i]:
                    this_type_new.insert(i, connection)
                    break
                elif compare_index(connection, this_type_new[i]) == connection:
                    if i == len(this_type_new)-1:
                        this_type_new.append(connection)
    return this_type_new
    
def reorder_same_degree(conn_list):
    #This function reorders a list of connections of the same degree.
    original_list = conn_list
    reorder_list = []
    while len(original_list) > 0:
        type = getpair(original_list[0])
        this_type = []
        for connection in original_list:
            if getpair(connection) == type:
                this_type.append(connection)
                original_list.remove(connection)
        reorder_list = reorder_list + reorder_same_type(this_type, type)
    return reorder_list

#It would be better if the input is the 'abstract point list,' i.e. [((point1),(point2)),...].
conn_deg1 = []
conn_deg2 = []
conn_deg3 = []
conn_deg4 = []

#Test
abstractPointList = [((~8,0), (1,0)), ((~1,0), (7,0)), ((~7,0), (6,0)), ((~6,0), (1,1)), ((~1,1), (7,1)), ((~7,1), (8,0))]

for connection in abstractPointList:
    if (getpair(connection) in deg1) == True:
        conn_deg1.append(connection)
    elif (getpair(connection) in deg2) == True:
        conn_deg2.append(connection)
    elif (getpair(connection) in deg3) == True:
        conn_deg3.append(connection)
    elif (getpair(connection) in deg4) == True:
        conn_deg4.append(connection)
sorted = reorder_same_degree(conn_deg1) + reorder_same_degree(conn_deg2) + reorder_same_degree(conn_deg3) + reorder_same_degree(conn_deg4)

print(sorted)
"Output should be [((edge1, index1), (edge2, index2)), ...] in the order of connection."
#sortedPointPairs = sorted(pairedPointsList, key = get_param_dist, reverse = True)
# ---------- end sort_points_by_push_order ----------
opacity = Slider(255, range=0..255)
color = Slider(0, range=0..19)
opacity_2 = Slider(255, range=0..255)
opacity_3 = Slider(255, range=0..255)
opacity_4 = Slider(177, range=0..255)
color_2 = Slider(8, range=0..19)
opacity_5 = Slider(255, range=0..255)
color_3 = Slider(3, range=0..19)
opacity_6 = Slider(255, range=0..255)
color_4 = Slider(2, range=0..19)
color_5 = Slider(6, range=0..19)
color_6 = Slider(4, range=0..19)
mypreview = RGBPreview(G=sph_2, A=opacity, N=color)
mypreview_2 = RGBPreview(G=sph, A=opacity_3, N=color_3)
mypreview_3 = RGBPreview(G=crv_3, A=opacity_2, N=color_2)
mypreview_4 = RGBPreview(G=s20_and_master_curve_cluster.geo_3, A=opacity_4, N=color_4)
mypreview_5 = RGBPreview(G=crv_4, A=opacity_5, N=color_5)
mypreview_6 = RGBPreview(G=crv_5, A=opacity_6, N=color_6)
panel_9 = Panel(sort_points_by_push_order.out)
fully_push_curve = GhPythonScript(
    curve=s20_and_master_curve_cluster.full_curve,
    brep=s20_and_master_curve_cluster.geo_3,
    pointPairs=abstract_points_to_rhino3dpoints.pairedPushPoints3D)  # -> out, pushedCurveFragments; inputs pointPairs: list
# ---------- fully_push_curve: Python ----------
"""Provides a scripting component.
    Inputs:
        curve: Initial Master Curve, parametrized to [0,1]
        pointPairs: A list of pairs of points to use for pushing, in order
    Output:
        a: The a output variable"""

__author__ = "Shoon"
__version__ = "2021.02.26"

import rhinoscriptsyntax as rs
import Grasshopper as gh
import os

# Coerce inputs
curve = rs.coercecurve(curve)
brep = rs.coercebrep(brep)

# Set cluster path
par = os.path.abspath(os.path.join(os.path.dirname(ghenv.Component.OnPingDocument().FilePath)))
clusterFilePath = os.path.join(par, "PushCurvePart.ghcluster")


def iterate_push (doc, curve, dStart, dEnd):    
    cluster = gh.Kernel.Special.GH_Cluster()
    cluster.CreateFromFilePath(clusterFilePath)
    cluster.Params.Input[0].AddVolatileData(gh.Kernel.Data.GH_Path(0), 0, curve)
    cluster.Params.Input[1].AddVolatileData(gh.Kernel.Data.GH_Path(0), 0, dStart)
    cluster.Params.Input[2].AddVolatileData(gh.Kernel.Data.GH_Path(0), 0, dEnd)
    cluster.Params.Input[3].AddVolatileData(gh.Kernel.Data.GH_Path(0), 0, brep)
    a = gh.Kernel.Parameters.Param_Curve()
    b = gh.Kernel.Parameters.Param_Curve()
    
    cluster.Params.RegisterOutputParam(a)
    cluster.Params.RegisterOutputParam(b)
    doc.Enabled = True
    doc.AddObject(cluster, True, 0)
    pushedFrag = cluster.Params.Output[0].VolatileData
    newMasterCurve = cluster.Params.Output[0].VolatileData
    doc.Enabled = False
    doc.RemoveObject(cluster, False)
    return(a, b)

    
def main():
    # Get doc and set output vars
    doc = gh.Kernel.GH_Document()
    pushedCurveFragments = []
    masterCurve = curve
    
    for pair in [[0.5,0.6], [0.6,0.7]]:
        pair[0] = rs.EvaluateCurve(masterCurve, pair[0])
        pair[1] = rs.EvaluateCurve(masterCurve, pair[1])
        # Map 3-D points to parameters
        (pair0, pair1) = (rs.coerce3dpoint(pair[0]), rs.coerce3dpoint(pair[1]))
        (pair0, pair1) = (rs.CurveClosestPoint(masterCurve, pair0), rs.CurveClosestPoint(masterCurve, pair1))
        # Figure out how to do the start and end of the domains, espec if they go through 1
        # The logic for this might already be in the cluster, but I'm not sure.
        
        # push and get return values
        print(masterCurve, pair)
        (newFrag, masterCurve) = iterate_push(doc, masterCurve, pair[0], pair[1])
        pushedCurveFragments.append(newFrag)
        
    # destroy doc
    doc.Dispose()
    doc = None
        
    return(pushedCurveFragments)
    
pushedCurveFragments = main()
# ---------- end fully_push_curve ----------
panel_10 = Panel(fully_push_curve.out)
fully_push_curve_original_ver = GhPythonScript(
    curve=s20_and_master_curve_cluster.full_curve,
    brep=s20_and_master_curve_cluster.geo_3,
    pointPairs=sort_points_by_push_order.sortedPointPairs)  # -> out, pushedCurveFragments; inputs pointPairs: list; same code as fully_push_curve
partly_pushed_full_curve = PartlyPushedFullCurve(
    curve=s20_and_master_curve_cluster.full_curve,
    domain_start=Slider(0.593, range=0..1),
    domain_end=Slider(0.603, range=0..1),
    brep=s20_and_master_curve_cluster.geo_3)  # -> curve_4, curve_3

# ==== cluster PartlyPushedFullCurve
curve = ClusterInput()
number = Number(0.0001)
number_2 = Number(0.01)
curve_2 = Curve(reparameterize(curve))
brep = ClusterInput()
domain_start = ClusterInput()
domain_end = ClusterInput()
construct_domain = ConstructDomain(DomainStart=domain_start, DomainEnd=domain_end)
sub_curve = SubCurve(BaseCurve=reparameterize(curve_2), Domain=construct_domain)
number_3 = Number(500)
number_4 = Number(-30)
curve_contraction_cluster = CurveContractionCluster(brep=brep, curve=sub_curve, steps=number_3, rightwards=number_4)  # -> curve_3, point
ghpython_script = GhPythonScript(
    start=domain_start,
    end=domain_end,
    step=number,
    separation=number_2,
    baseCurve=curve_2,
    pushedPoints=curve_contraction_cluster.point)  # -> out, points; inputs pushedPoints: list
# ---------- ghpython_script: Python ----------
__author__ = "Shoon"
__version__ = "2021.01.27"

import rhinoscriptsyntax as rs

points = []

def frange(a,b,s):
    x = float(a)
    while x < b:
        yield x
        x+=s


[points.append(rs.EvaluateCurve(baseCurve,i)) for i in frange(max(0,end+separation-1),max(0,end+separation-1,start-separation),step)]

points += rs.coerce3dpointlist(pushedPoints)

[points.append(rs.EvaluateCurve(baseCurve,i)) for i in frange(min(end+separation,1,1+start-separation),min(1+start-separation,1),step)]
# ---------- end ghpython_script ----------
interpolate_t = InterpolateT(Vertices=ghpython_script.points, TangentStart=Vector(0, 0, 0), TangentEnd=Vector(0, 0, 0), KnotStyle=1)  # -> Curve, Length, Domain
curve_3 = ClusterOutput(interpolate_t.Curve)
curve_4 = ClusterOutput(curve_contraction_cluster.curve_3)

# ==== cluster S20AndMasterCurveCluster
raw_map_curves = Curve([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])
crv = Curve(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)
crv_2 = Curve(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)
crv_3 = Curve(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)
crv_4 = Curve(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)
P = ClusterInput()
crv_5 = Curve([crv, crv_2, crv_3, crv_4])
integer = Integer(500)
geo = ClusterInput()
geo_2 = Geometry(geo)
cluster = Cluster(curve=crv_5, brep=geo_2, steps=integer)
eval = EvaluateCurve(Curve=reparameterize(crv), Parameter=Slider(0, range=0..1))  # -> Point, Tangent, Angle
construct_domain = ConstructDomain(DomainStart=0, DomainEnd=1)
map_curves_on_polysurface = Curve(reparameterize(cluster))
cir = Circle(Plane=P, Radius=Slider(10, range=0..10))
integer_2 = Integer(8)
epsilon = ClusterInput()
project = Project(Curve=cir, Brep=geo_2, Direction=Vector(0, 0, 1))
range = Range(Domain=construct_domain, Steps=integer_2)
item = ListItem(List=project, Index=0, Wrap=True)
number = Number(1)
epsilon_2 = Number(epsilon)
cluster_2 = Cluster_3(brep=geo_2, curve=map_curves_on_polysurface, rightwards=number, C=item, num=epsilon_2)  # -> full_curve_2, right_shifted_curves_2, original_curves_2, punct_curves
original_curves = ClusterOutput(cluster_2.original_curves_2)
punct_curves = ClusterOutput(cluster_2.punct_curves)
offset_curves = ClusterOutput(cluster_2.right_shifted_curves_2)
full_curve = ClusterOutput(cluster_2.full_curve_2)
geo_3 = ClusterOutput(geo_2)
split = SplitList(List=range, Index=1)  # -> ListA, ListB
evaluate_curve = EvaluateCurve(Curve=reparameterize(item), Parameter=split.ListB)  # -> Point, Tangent, Angle
raw_puncture_curves = Curve([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])
opacity = Slider(255, range=0..255)
color = Slider(2, range=0..19)
offset_curves_almost_on_polysurface = Curve(reparameterize(cluster_2.right_shifted_curves_2))
cluster_3 = Cluster_2(curve=raw_puncture_curves, brep=geo_2)
pt = Point(evaluate_curve.Point)
pt_2 = ClusterOutput(pt)
mypreview = RGBPreview(G=geo_2, A=opacity, N=color)
puncture_curves_on_polysurface = Curve(reparameterize(cluster_3))
merge = Merge(Data1=map_curves_on_polysurface, Data2=offset_curves_almost_on_polysurface, Data3=puncture_curves_on_polysurface)
join_curves = JoinCurves(Curves=merge, Preserve=False)
curve_failed_fr_some_reason = Curve(join_curves)
master_curve_raw = Curve(reparameterize(<curve referenced from the Rhino model>))
fit_curve_smooth = FitCurveSmooth(Curve=master_curve_raw, FitTolerance=0.001, AngleTolerance=1)
master_curve_smooth = Curve(fit_curve_smooth)

# ==== cluster Genus2Surface
number_slider = Slider(4, range=0..16)
wide = ClusterInput()
multiplication = Multiplication(A=number_slider, B=2)
long = ClusterInput()
round = ClusterInput()
thick = ClusterInput()
subtraction = Subtraction(A=number_slider, B=1)
taper = ClusterInput()
pt = ConstructPoint(XCoordinate=Slider(0.5, range=0..1), YCoordinate=Slider(0.403, range=0..1), ZCoordinate=0)

# ----
# wonky tori
number_slider_2 = Slider(16.8, range=0..20)
addition = Addition(A=number_slider_2, Wide=wide)
dom = ConstructDomain(DomainStart=0, DomainEnd=1)
ellipse = Ellipse(Plane=PlaneXY(0, 0, 0), Radius1=number_slider_2, Radius2=addition)  # -> reparameterize(Ellipse), Focus1, Focus2
range = Range(Domain=dom, Steps=multiplication)
num = Number(range)
curvature = Curvature(Curve=ellipse.Ellipse, Parameter=num)  # -> P, unitize(K), C
python = GhPythonScript(x=num, long=long, round=round, thick=thick)  # -> out, a, b, c
# ---------- python: Python ----------
__author__ = "will"
__version__ = "2020.07.08"

import rhinoscriptsyntax as rs

a = ((x-.5)*long)**6

b = ((x-.5)*round)**2 + thick

c = a + thick
# ---------- end python ----------
rev = Reverse(Vector=curvature.K)
multiplication_2 = Multiplication(A=rev, B=python.a)
number_slider_3 = Slider(12, range=0..30)
addition_2 = Addition(A=multiplication_2, B=curvature.P)
Z = UnitZ(Factor=1)
dom_2 = ConstructDomain(DomainStart=0, DomainEnd=1)
pl = ConstructPlane(Origin=addition_2, XAxis=Z, YAxis=curvature.K)
range_2 = Range(Domain=dom_2, Steps=number_slider_3)
ellipse_2 = Ellipse(Plane=pl, Radius1=python.b, Radius2=python.c)  # -> reparameterize(Ellipse), Focus1, Focus2
split = SplitList(List=range_2, Index=number_slider_3)  # -> graft(ListA), ListB
item = ListItem(List=addition_2, Index=0, Wrap=True)
eval = EvaluateCurve(Curve=ellipse_2.Ellipse, Parameter=split.ListA)  # -> Point, Tangent, Angle
split_2 = SplitList(List=ellipse_2.Ellipse, Index=1)  # -> ListA, ListB
yz = YZPlane(Origin=Point(0, 0, 0))
intcrv = Interpolate(Vertices=eval.Point, Degree=3, Periodic=True, KnotStyle=1)  # -> flatten(Curve), Length, Domain
pl_origin = PlaneOrigin(Base=yz, Origin=item)
number_slider_4 = Slider(0.3, range=0..1)
addition_3 = Addition(A=number_slider_4, Taper=taper)

shift = ShiftList(List=split_2.ListB, Shift=subtraction, Wrap=True)

netsurf = NetworkSurface(CurvesU=shift, CurvesV=intcrv.Curve, Continuity=2)
mirror = Mirror(Geometry=netsurf, Plane=pl_origin)  # -> Geometry, Transform
join = BrepJoin(Breps=[mirror.Geometry, netsurf])  # -> Breps, Closed
taper_2 = Taper(
    Geometry=join.Breps,
    Axis=Line((-30, 0, 0), (80, 0, 0)),
    Start=number_slider_4,
    End=addition_3,
    Flat=False,
    Infinite=False,
    Rigid=False)
item_2 = ListItem(List=taper_2, Index=1, Wrap=True)
item_3 = ListItem(List=taper_2, Index=0, Wrap=True)

# ----
# Waist
hilonums = HighestLowestNumbers(Numbers=python.c)  # -> Highest, Lowest
number_slider_5 = Slider(7.305, range=0..10)
number_slider_6 = Slider(3.563, range=0..4)
number_slider_7 = Slider(2.366, range=0..4)
multiplication_3 = Multiplication(A=hilonums.Highest, B=2)
neg = Negative(Value=number_slider_7)
neg_2 = Negative(Value=number_slider_6)
neg_3 = Negative(Value=number_slider_5)
division = Division(A=hilonums.Highest, B=[neg_3, neg_2, neg])
division_2 = Division(A=hilonums.Highest, B=[number_slider_7, number_slider_6, number_slider_5])
X = UnitX(Factor=division_2)
X_2 = UnitX(Factor=division)
bbox = BoundingBox(Content=taper_2, Plane=PlaneXY(0, 0, 0), UnionBox=True)  # -> Box, Box_2
move = Move(Geometry=pl_origin, Motion=X)  # -> Geometry, Transform
move_2 = Move(Geometry=pl_origin, Motion=X_2)  # -> Geometry, Transform
box_corners = BoxCorners(Box=bbox.Box)  # -> CornerA, CornerB, CornerC, CornerD, CornerE, CornerF, CornerG, CornerH
pdecon = Deconstruct(Point=box_corners.CornerA)  # -> XComponent, YComponent, ZComponent
neg_4 = Negative(Value=pdecon.YComponent)
dom_3 = ConstructDomain(DomainStart=neg_4, DomainEnd=pdecon.YComponent)
planesrf = PlaneSurface(Plane=move_2.Geometry, XSize=dom_3, YSize=dom_3)
planesrf_2 = PlaneSurface(Plane=move.Geometry, XSize=dom_3, YSize=dom_3)
bbx = BrepBrep(BrepA=planesrf, BrepB=item_2)  # -> flatten(Curves), Points
bbx_2 = BrepBrep(BrepA=planesrf_2, BrepB=item_3)  # -> flatten(Curves), Points
crv = Curve([bbx_2.Curves, bbx.Curves])
loft = Loft(Curves=flatten(crv), Options={Adjust=True, Closed=False, LoftEnds=0, LoftSimp=0, LoftType=1, Rebuild=10, Refit=0.01})

# ----
# Trimmed wonky tori
item_4 = ListItem(List=planesrf, Index=-1, Wrap=True)
item_5 = ListItem(List=planesrf_2, Index=0, Wrap=True)
X_3 = UnitX(Factor=multiplication_3)
neg_5 = Negative(Value=X_3)
extr = Extrude(Base=item_5, Direction=neg_5)
extr_2 = Extrude(Base=item_4, Direction=X_3)
trim = TrimSolid(Shape=item_2, Cutters=extr_2)
trim_2 = TrimSolid(Shape=item_3, Cutters=extr)

evalsrf = EvaluateSurface(Surface=reparameterize(loft), Point=pt)  # -> Point, Normal, UDirection, VDirection, Frame
L = ClusterOutput(loft)
pl_2 = PlaneNormal(Origin=evalsrf.Point, ZAxis=evalsrf.Normal)
join_2 = BrepJoin(Breps=flatten([trim, loft, trim_2]))  # -> Breps, Closed
P = ClusterOutput(pl_2)
geo = Geometry(join_2.Breps)
geo_2 = ClusterOutput(geo)

# ==== cluster CurveContractionCluster
steps = ClusterInput()
brep = ClusterInput()
rightwards = ClusterInput()
curve = ClusterInput()
curve_2 = Curve(curve)
range = Range(Domain=Domain(0, 1), Steps=steps)
evaluate_curve = EvaluateCurve(Curve=reparameterize(curve_2), Parameter=range)  # -> Point, Tangent, Angle
brep_2 = Brep(brep)
brep_closest_point = BrepClosestPoint(Point=evaluate_curve.Point, Brep=brep_2)  # -> Point, Normal, Distance
script_1_tbd = GhPythonScript(x=evaluate_curve.Point, y=evaluate_curve.Tangent, z=brep_closest_point.Normal, Rightwards=rightwards)  # -> out, shiftedPoints
# ---------- script_1_tbd: Python ----------
"""Provides a scripting component.
    Inputs:
        x: Points along Curve
        y: Vectors tangent to curve at each point
        z: Vectors normal to surface at each point
        inwards: 1 if you want to shift curve inwards, -1 if outwards
    Output:
        a: The a output variable"""

__author__ = "Shoon"
__version__ = "2020.11.04"

import rhinoscriptsyntax as rs

epsilon = 0.01

print(x)
print(y)
print(z)

# Compute the cross product of the above two vectors at each point
crosses = Rightwards * rs.VectorCrossProduct(z,y)

# Displace points along said cross product by some distance
shiftedPoints = rs.VectorAdd(x,epsilon*crosses)

# Copy points up by epsilon and down by epsilon to form a ribbon


# Take the intersection of the ribbon with the surface and draw it
# ---------- end script_1_tbd ----------
brep_closest_point_2 = BrepClosestPoint(Point=script_1_tbd.shiftedPoints, Brep=brep_2)  # -> Point, Normal, Distance
point = ClusterOutput(brep_closest_point_2.Point)
interpolate = Interpolate(Vertices=brep_closest_point_2.Point, Degree=3, Periodic=False, KnotStyle=1)  # -> Curve, Length, Domain
curve_3 = ClusterOutput(interpolate.Curve)

# ==== cluster RGBPreview: Custom Preview clustered with RGB module with preset colors
N = ClusterInput()
python = GhPythonScript(N=N)  # -> out, R, G, B
# ---------- python: Python ----------
__author__ = "will"
__version__ = "2020.07.20"

import rhinoscriptsyntax as rs

colors=[(0,0,0),(255,255,255),(115,115,115),(255,0,0),(0,255,0),(0,0,255),(255,255,0),(255,0,255),(0,255,255),(0,162,255),(252,124,21),(124,51,202),(23,151,59),(255,80,90),(255,80,226),(32,214,255),(0,92,0),(0,0,120),(112,255,49),(138,78,0)]

N=int(N)
R = colors[N][0]
G = colors[N][1]
B = colors[N][2]
# ---------- end python ----------
A = ClusterInput()
G = ClusterInput()
rgb = ColourRGB(Alpha=A, Red=python.R, Green=python.G, Blue=python.B)
preview = CustomPreview(Geometry=G, Material=rgb)

# ==== cluster Cluster
steps = ClusterInput()
curve = ClusterInput()
range = Range(Domain=Domain(0, 1), Steps=steps)
evaluate_curve = EvaluateCurve(Curve=reparameterize(graft(curve)), Parameter=range)  # -> Point, Tangent, Angle
brep = ClusterInput()
brep_closest_point = BrepClosestPoint(Point=evaluate_curve.Point, Brep=brep)  # -> Point, Normal, Distance
interpolate = Interpolate(Vertices=brep_closest_point.Point, Degree=3, Periodic=False, KnotStyle=1)  # -> Curve, Length, Domain
curve_2 = ClusterOutput(interpolate.Curve)

# ==== cluster Cluster_2
integer = Integer(500)
curve = ClusterInput()
range = Range(Domain=Domain(0, 1), Steps=integer)
evaluate_curve = EvaluateCurve(Curve=reparameterize(graft(curve)), Parameter=range)  # -> Point, Tangent, Angle
brep = ClusterInput()
brep_closest_point = BrepClosestPoint(Point=evaluate_curve.Point, Brep=brep)  # -> Point, Normal, Distance
interpolate = Interpolate(Vertices=brep_closest_point.Point, Degree=3, Periodic=False, KnotStyle=1)  # -> Curve, Length, Domain
curve_2 = ClusterOutput(interpolate.Curve)

# ==== cluster Cluster_3
curve = ClusterInput()
curve_2 = Curve(curve)
num = ClusterInput()
range = Range(Domain=Domain(0, 1), Steps=1000)
brep = ClusterInput()
evaluate_curve = EvaluateCurve(Curve=reparameterize(curve_2), Parameter=range)  # -> Point, Tangent, Angle
brep_2 = Brep(brep)
C = ClusterInput()
brep_closest_point = BrepClosestPoint(Point=evaluate_curve.Point, Brep=brep_2)  # -> Point, Normal, Distance
pt = Point(evaluate_curve.Point)
crv_cp = CurveClosestPoint(Point=pt, Curve=C)  # -> Point, Parameter, Distance
dist = Distance(PointA=pt, PointB=crv_cp.Point)
num_2 = Number(num)
rightwards = ClusterInput()
script_1_tbd = GhPythonScript(
    x=evaluate_curve.Point,
    y=evaluate_curve.Tangent,
    z=brep_closest_point.Normal,
    Rightwards=rightwards,
    D=dist,
    epsilon=num_2)  # -> out, shiftedPoint, point
# ---------- script_1_tbd: Python ----------
"""Provides a scripting component.
    Inputs:
        x: Points along Curve
        y: Vectors tangent to curve at each point
        z: Vectors normal to surface at each point
        inwards: 1 if you want to shift curve inwards, -1 if outwards
    Output:
        a: The a output variable"""

__author__ = "Shoon"
__version__ = "2020.11.04"

import rhinoscriptsyntax as rs



print(x)
print(y)
print(z)

# Compute the cross product of the above two vectors at each point
crosses = Rightwards * rs.VectorCrossProduct(z,y)

# Displace points along said cross product by some distance

if D>=2:
    shiftedPoint = rs.VectorAdd(x,epsilon*crosses)
    point = x
else:
    shiftedPoint = rs.VectorAdd(x,((1/16)*(1/epsilon-1)*(D-2)**2+1)*epsilon*crosses)
    point = rs.VectorAdd(x,-((1/16)*(1/epsilon-1)*(D-2)**2)*epsilon*crosses)

# Copy points up by epsilon and down by epsilon to form a ribbon


# Take the intersection of the ribbon with the surface and draw it
# ---------- end script_1_tbd ----------
brep_closest_point_2 = BrepClosestPoint(Point=script_1_tbd.point, Brep=brep_2)  # -> Point, Normal, Distance
brep_closest_point_3 = BrepClosestPoint(Point=script_1_tbd.shiftedPoint, Brep=brep_2)  # -> Point, Normal, Distance
pt_2 = Point(reverse(brep_closest_point_3.Point))
interpolate = Interpolate(Vertices=brep_closest_point_3.Point, Degree=3, Periodic=False, KnotStyle=1)  # -> Curve, Length, Domain
pt_3 = Point(brep_closest_point_2.Point)
intcrv = Interpolate(Vertices=brep_closest_point_2.Point, Degree=3, Periodic=False, KnotStyle=1)  # -> Curve, Length, Domain
stack = StackTrees(Data0=pt_3, Data1=pt_2, Reduce=True)
panel = Panel("""0
7
1
6
5
4
2
3""")
flip = FlipMatrix(Data=stack)
item = ListItem(List=flip, Index=panel, Wrap=True)
flip_2 = FlipMatrix(Data=item)  # -> flatten(Data)
num_3 = Number(num_2)
intcrv_2 = Interpolate(Vertices=flip_2, Degree=3, Periodic=True, KnotStyle=1)  # -> Curve, Length, Domain
division = Division(A=intcrv_2.Length, B=num_3)
integer_division = IntegerDivision(A=division, B=1)
range_2 = Range(Domain=Domain(0, 1), Steps=integer_division)
evaluate_curve_2 = EvaluateCurve(Curve=reparameterize(intcrv_2.Curve), Parameter=range_2)  # -> Point, Tangent, Angle
brep_closest_point_4 = BrepClosestPoint(Point=evaluate_curve_2.Point, Brep=brep_2)  # -> Point, Normal, Distance
right_shifted_curves = Curve(reparameterize(interpolate.Curve))
original_curves = Curve(reparameterize(intcrv.Curve))
intcrv_3 = Interpolate(Vertices=brep_closest_point_4.Point, Degree=3, Periodic=True, KnotStyle=1)  # -> Curve, Length, Domain
end = EndPoints(Curve=original_curves)  # -> flatten(Start), flatten(End)
end_2 = EndPoints(Curve=right_shifted_curves)  # -> flatten(Start), flatten(End)
full_curve = Curve(reparameterize(intcrv_3.Curve))
panel_2 = Panel("""12
3
13
2
1
0
14
15""")
panel_3 = Panel("""7
9
6
5
4
10
11
8""")
pt_4 = Point([end_2.Start, end_2.End, end.Start, end.End])
item_2 = ListItem(List=pt_4, Index=panel_2, Wrap=True)
item_3 = ListItem(List=pt_4, Index=panel_3, Wrap=True)
crv_cp_2 = CurveClosestPoint(Point=item_2, Curve=full_curve)  # -> Point, Parameter, Distance
crv_cp_3 = CurveClosestPoint(Point=item_3, Curve=full_curve)  # -> Point, Parameter, Distance
python = GhPythonScript(t=crv_cp_3.Parameter)  # -> out, t
# ---------- python: Python ----------
__author__ = "will"
__version__ = "2021.04.03"

import rhinoscriptsyntax as rs

if t < .01:
    t = 1
# ---------- end python ----------
dom = ConstructDomain(DomainStart=crv_cp_2.Parameter, DomainEnd=python.t)
subcrv = SubCurve(BaseCurve=full_curve, Domain=dom)
punct_curves = ClusterOutput(subcrv)
full_curve_2 = ClusterOutput(full_curve)
right_shifted_curves_2 = ClusterOutput(right_shifted_curves)
original_curves_2 = ClusterOutput(original_curves)
